# Grasshopper definition basic.gh (Grasshopper 1.0.7)
# plug-ins: SimScale 

download = DownloadAndProcessResults(
    ProjectName="Grasshopper Integration Example - API",
    SimulationName="Boston",
    SimulationRunName="16 - Direction, corrected Exposure",
    Run=Toggle(False))
speeds = CollectWindSpeeds(SimScaleObject=download, WindDirection="210", SpeedMultiplier="5")
